# Grasshopper definition ClasticSrf.gh (Grasshopper 1.0.7)
# plug-ins: ShapeDiverForGrasshopper

size = GetNumber(
    Slider(69, range=6..100),
    AtLeast=1,
    AtMost=1,
    Maximum=1.797693135e+308,
    Minimum=-1.797693135e+308,
    Prompt="size of the surface [1.0 ... 12.0]",
    TreeAccess=False)
bendiness = GetNumber(
    Slider(-14.38, range=-25..25),
    AtLeast=1,
    AtMost=1,
    Maximum=1.797693135e+308,
    Minimum=-1.797693135e+308,
    Prompt="float of curvature - negative will be antisynclastic, positive will be synclastic [-10.0...10.0]",
    TreeAccess=False)
sddp = ShapeDiverDocumentPayload({AbsoluteTolerance=0, AngleTolerance=0, DistanceDisplayPrecision=0, GltfVersion="Gltf2", GrasshopperVersion="1.0.0007", InputGroups="{}", OutputGroups="{}", RelativeTolerance=0, RhinoVersion="7.35.23346.11001", UnitSystem=0, VersionCreated="1.16.1.0", VersionSaved="1.16.1.0"})
circle = Circle(Plane=PlaneXY(0, 0, 0), Radius=size)
divide_curve = DivideCurve(Curve=circle, Count="4", Kinks=False)  # -> Points, Tangents, Parameters
list_item = ListItem(List=divide_curve.Points, Index=0, Wrap=True)  # -> Item, Item1, Item2
point = Point(list_item.Item1)
point_2 = Point(list_item.Item)
point_3 = Point(list_item.Item2)
distance = Distance(PointA=point, PointB=point_2)
absolute = Absolute(Value=bendiness)
distance_2 = Distance(PointA=point, PointB=point_3)
unit_z = UnitZ(Factor=bendiness)
minimum = Minimum(A=bendiness, B="0")
addition = Addition(A=distance, B=absolute)
addition_2 = Addition(A=distance_2, B=absolute)
unit_z_2 = UnitZ(Factor=absolute)
roughness = GetInteger(
    Slider(50, range=5..50),
    AtLeast=1,
    AtMost=1,
    Maximum=2147483647,
    Minimum=-2147483648,
    Prompt="how rough the surface is [5...50]",
    TreeAccess=False)
multiplication = Multiplication(A=minimum, B=0.1)
catenary = Catenary(PointA=point, PointB=point_3, Length=addition_2, Gravity=unit_z)
multiplication_2 = Multiplication(A=absolute, B=0.1)
catenary_2 = Catenary(PointA=point, PointB=point_2, Length=addition, Gravity=unit_z_2)
construct_domain = ConstructDomain(DomainStart=multiplication_2, DomainEnd=multiplication)
divide_curve_2 = DivideCurve(Curve=catenary, Count=roughness, Kinks=False)  # -> Points, Tangents, Parameters
vector_2pt = Vector2Pt(PointA=point, PointB=divide_curve_2.Points, Unitize=False)  # -> Vector, Length
move = Move(Geometry=catenary_2, Motion=vector_2pt.Vector)  # -> Geometry, Transform
divide_curve_3 = DivideCurve(Curve=move.Geometry, Count=roughness, Kinks=False)  # -> Points, Tangents, Parameters
panel = Panel(construct_domain)
list_length = ListLength(List=divide_curve_3.Points)
range = Range(Domain=Domain(0, 1), Steps=roughness)
multiplication_3 = Multiplication(A=range, B=Slider(100, range=0..100))
random = Random(Range=panel, Number=list_length, Seed=graft(multiplication_3))
unit_z_3 = UnitZ(Factor=random)
move_2 = Move(Geometry=divide_curve_3.Points, Motion=unit_z_3)  # -> Geometry, Transform
surface_from_points = SurfaceFromPoints(Points=flatten(move_2.Geometry), UCount=expr("x+1", roughness), Interpolate=False)
context_bake = ContextBake(SurfaceOut=surface_from_points)
custom_preview = CustomPreview(Geometry=surface_from_points, Material=ColourSwatch(SwatchColor=RGB(230, 172, 122)))
